vi "Main Window.gvi"   [LabVIEW NXG 5.0.0]
panel controls:
  "Acquire Multiple Rainbow Button": bool
  "Load Multiple Measurement": bool
  "Save Multiple Measurement": bool
  "IV Curve Parameters": "IV Curve Parameters.gtype"
  "Cell Selector": "Cell Selector.gtype"
  "Main Tab": i32
  "Custom date": bool
  "Author Initials": string
  "Batch Name": string
  "Cell Number": string
  "Sample Comments": string
  "Abort Button": bool
  "Exit App Button": bool
  "Add Layer Button": bool
  "Add Layer Button_2": bool
  "Add Layer Button_3": bool
  "Queue In": Queue<"Queue Instructions Control.gtype">
  "Misc Mega Cluster": "Misc Mega Cluster.gtype"
  "Label Info Error Label": string
  "Label Info Missing Error": bool
  "Config Tab": i32
panel indicators:
  "IV Plot Out Multiple": "SRM Single Plot Cluster.gtype"[]
  "Current Date": string
  "Progress %": f64
  "State": string
  "Substate": string
  "Sample Prefix": string
  "Progress counter": f64
  "Layer Information": string[]
  "Live IV Parameters": T2
  "Queue Out": Queue<"Queue Instructions Control.gtype">
types:
  "SRM Single Plot Cluster.gtype" = cluster{"Voltage (V)": f64[], "Current Density (A/m^2)": f64[]}
  "IV Mode.gtype" = enum{"Rough", "Normal", "Accurate", "Smart"}
  "IV Curve Parameters.gtype" = cluster{"Max (V)": f64, "Min (V)": f64, "V Points": u32, "Curr Range (A)": f64, "Sweep Dir": bool, "Current Avg": u32, "Max (A)": f64, "Integration Time": f64, "Autorange": bool, "Cell Area (m^2)": f64, "Light Power (W m^-2)": f64, "Iterations": u32, "IV Mode": "IV Mode.gtype"}
  T1 = cluster{"L.01": bool, "R.01": bool, "L.02": bool, "R.02": bool, "L.03": bool, "R.03": bool, "L.04": bool, "R.04": bool, "L.05": bool, "R.05": bool, "L.06": bool, "R.06": bool, "L.07": bool, "R.07": bool, "L.08": bool, "R.08": bool, "L.09": bool, "R.09": bool, "L.10": bool, "R.10": bool, "L.11": bool, "R.11": bool, "L.12": bool, "R.12": bool}
  "Cell Selector.gtype" = cluster{"All": bool, "Left": bool, "Right": bool, "Cell Cluster": T1, "Reset": bool, "Random Order ": bool, "Reset_2": bool}
  T2 = cluster{"Current (A)": f64, "Voltage (V)": f64, "Current Density (A/m^2)": f64, "Current Cell": enum{""}}
  "Queue Instructions Control.gtype" = enum{"Undefined State", "Debug Check", "Initialize App", "Idle", "Change Cell", "IV Curve", "Saving TXT Files", "Generating Origin Files", "Stopping App", "State 1", "State2", "State3", "State4", "State5"}
  "Full Reference Cluster.gtype" = cluster{"Sample Extra Information": "Sample extra imformation.gtype", "Acquisition Parameters": "Acquisition Parameters.gtype", "Status Report": "Status Report.gtype", "Live Progress": "Live Progress.gtype", "Sample Naming Cluster": "Sample Naming Cluster.gtype"}
  "Misc Mega Cluster.gtype" = cluster{"Full Reference Cluster": "Full Reference Cluster.gtype"}
  "Acquisition Parameters.gtype" = cluster{"Cell Selector": "Cluster reference", "IV Curve Parameters": "Cluster reference"}
  "Sample extra imformation.gtype" = cluster{"Layer Information": "ArrayViewer reference"[]}
  "Live Progress.gtype" = cluster{"Progress %": "ProgressBar reference", "Progress Counter": "NumericTextBoxDouble reference", "Live IV Parameters": "Cluster reference"}
  "Sample Naming Cluster.gtype" = cluster{"Author Initials": "ComboBoxSelector reference", "Batch Name": "StringControl reference", "Cell Number": "StringControl reference", "Current Date": "StringControl reference", "Sample Comments": "StringControl reference", "Sample Prefix": "StringControl reference", "Custom Date": "CheckBox reference", "Label Info Error Label Ref": "StringControl reference", "Label Info Missing Error Ref": "BooleanControl reference"}
  "Status Report.gtype" = cluster{"State": "StringControl reference", "Substate": "StringControl reference"}
uses:
  Pika IV Characterization NXG::Side Functions::Abort Control::FGV Global Abort.gvi
  Pika IV Characterization NXG::Main Functions::Instruction Handling::FGV Current State.gvi
  Pika IV Characterization NXG::Side Functions::Exit App Sequence.gvi
  NI::G Core::Error::Is Error.gvi
  Pika IV Characterization NXG::Side Functions::Abort Control::Abort Sequence.gvi
  NI::G Core::Error::Multiplex Errors.gvi
  NI::G Core::Error::Display Error.gvi
diagram:
  case (TRUE) {
    frame False, Default {
      w1 = default
    }
    frame True {
      Property Node(instance in="Acquisition Parameters.gtype" {all zero or empty}, "Cell Selector"=reference to "Cell Selector", "IV Curve Parameters"=reference to "IV Curve Parameters") -> (instance out=w2)
      Property Node(instance in="Sample extra imformation.gtype" {all zero or empty}, "Layer Information"=reference to "Layer Information") -> (instance out=w3)
      Property Node(instance in="Live Progress.gtype" {all zero or empty}, "Progress %"=reference to "Progress %", "Progress Counter"=reference to "Progress counter", "Live IV Parameters"=reference to "Live IV Parameters") -> (instance out=w4)
      Property Node(instance in="Sample Naming Cluster.gtype" {all zero or empty}, "Author Initials"=reference to "Author Initials", "Batch Name"=reference to "Batch Name", "Cell Number"=reference to "Cell Number", "Current Date"=reference to "Current Date", "Sample Comments"=reference to "Sample Comments", "Sample Prefix"=reference to "Sample Prefix", "Custom Date"=reference to "Custom date", "Label Info Error Label Ref"=reference to "Label Info Error Label", "Label Info Missing Error Ref"=reference to "Label Info Missing Error") -> (instance out=w5)
      Property Node(instance in="Status Report.gtype" {all zero or empty}, "State"=reference to "State", "Substate"=reference to "Substate") -> (instance out=w6)
      Property Node(instance in="Full Reference Cluster.gtype" {all zero or empty}, "Sample Extra Information"=w3, "Acquisition Parameters"=w2, "Status Report"=w6, "Live Progress"=w4, "Sample Naming Cluster"=w5) -> (instance out=w7)
      Property Node(instance in=$"Misc Mega Cluster", "Full Reference Cluster"=w7) -> (instance out=w8)
      $"Misc Mega Cluster" <- w8
      w1 = no error
    }
  }
  call "FGV Global Abort.gvi"(Global Abort Instructions="Reset State", Error In=w1) -> (Error Out=w9)
  call "FGV Current State.gvi"(Current State Instructions="Set Current State and Substate", Current State="Undefined State", Current Substate="Starting Up", Error In=w9) -> (Error Out=w10)
  Obtain Queue(create if not found=TRUE, element data type="Queue Instructions Control.gtype" "Undefined State", error in=w10, name="Instruction Queue") -> (error out=w11, queue out=w12)
  Enqueue Element(element="Debug Check", error in=w11, queue=w12) -> (error out=w13, queue out=w14)
  s1 = w14  # shift register
  while {
    event (timeout = 50) {
      on "Timeout" {
        w15 = w13
        w16 = s1
        w17 = default
      }
      on "Exit App Button" Value changed {
        call "Exit App Sequence.gvi"(Queue In=s1, Exit App=$"Exit App Button", Error In=w13) -> (Queue Out=w16, Error Out=w15)
        w17 = default
      }
    }
    call "Is Error.gvi"(error in=w15) -> (error?=w18)
    Logical Or(w18, w17) -> w19
    next s1 = w16
    stop if w19
  }
  s2 = w14  # shift register
  s3 = w13  # shift register
  while {
    event (timeout = 100) {
      on "Timeout" {
        call "FGV Global Abort.gvi"(Global Abort Instructions="Read Current State", Error In=s3) -> (Global Abort Out=w23, Error Out=w24)
        Preview Queue Element(error in=w24, queue=s2, timeout in ms=100) -> (element=w25, error out=w20, queue out=w21)
        Is Equal(x=w25, y="Stopping App") -> w26
        Logical Or(w26, w23) -> w22
      }
      on "Abort Button" Value changed {
        call "Abort Sequence.gvi"(Queue In=s2, Global Abort=$"Abort Button", Error In=s3) -> (Queue Out=w21, Error Out=w20)
        w22 = default
      }
    }
    next s2 = w21
    next s3 = w20
    stop if w22
  }
  Enqueue Element(element="Stopping App", error in=s3, queue=s2) -> (error out=w27)
  s4 = w14  # shift register
  while {
    Dequeue Element(error in=w13, queue=s4) -> (element=w28, error out=w29, queue out=w30)
    case (w28) {
      frame "Undefined State", Default {
        w31 = _
        w32 = _
        w33 = default
      }
      frame "Debug Check" {
        w31 = w29
        w32 = w30
        w33 = default
      }
      frame "Stopping App" {
        w31 = _
        w32 = _
        w33 = TRUE
      }
    }
    call "Is Error.gvi"(error in=w31) -> (error?=w34)
    Logical Or(w34, w33) -> w35
    call "FGV Global Abort.gvi"(Global Abort Instructions="Reset State", Global Abort=w35, Error In=w31) -> (Error Out=w36)
    next s4 = w32
    stop if w35
  }
  Enqueue Element(element="Stopping App", error in=w36, queue=s4) -> (error out=w37)
  call "Multiplex Errors.gvi"(error in 1=w15, error in 2=w37, error in 3=w27) -> (error out=w38)
  Flush Queue(error in=w38, queue=s1) -> (error out=w39, queue out=w40)
  Release Queue(error in=w39, queue=w40) -> (error out=w41)
  case (w41) {
    frame Error, Default {
      # In case there is an error
      # put out an error handler
      call "Display Error.gvi"(error in=w41)
    }
    frame No Error { }
  }
